# Requirement set cruzcontrol (R2021a)

## 1 [Pushing gas pedal] Halting
When the driver pushes gas pedal and cruz_control_mode is working , change cruz_control_mode to off

## 2 [checking system] check
When the cruz control light is green and mode of cruz control is off , change mode of cruz control to working

## 3 [Pushing brake] Halt
When the driver pushes the break pedal , change mode cruz control to off and change cruz control light to red

## 4 [Turning on] system turn on
when the speed is more than 65 km/s and mode of cruz control is off and driver hold set button for at least 3 seconds , change cruz_control_mode to working on and change cruz control light to green

## 5 [Turning off the system] cruz control turn off
when the cruz control is on and cruz control light is green and driver hold the off button for 3 seconds , turn cruz control system off and change cruz_control_light to red

## 6 [changing mode] mode become changing speed
When cruz control is on and cruz control light is green and driver hold acc button for 3 seconds , change mode of cruz control to change_speed_mode and make cruz control light blinking

### 6.1 [increasing desired speed] changing desired speed
when mode of cruz control is change_speed_mode and driver push acc button, increase desired speed by one unit

### 6.2 [decreasing desired speed] changing desired speed
when mode of cruz control is change_speed_mode and driver push dec button, decrease desired speed by one unit

### 6.3 [setting the speed] setting desired speed
When mode of cruz control is change_speed_mode and driver hold set button for 5 seconds , stablize cruz control light and change mode of cruz control to working

## 7 [Accuracy] Speed accuracy (Informational)
The actual speed of the car after 15 second +/- 20% have to be same as desired speed that driver set before